# Requirement set CardiacDigitalTwin_Requirements (R2026a)

## 1 [REQ_CDT_001] When the prescribed beta-blocker dose (beta_blocker_dose_mg) increases from 50 mg to 60 mg, the cardiac digital twin shall reduce the steady-state heart rate by at least 2 bpm.
System-level dose-response acceptance criterion for the metoprolol +20% titration scenario.
Steady state is defined as the response after t >= 5 * pk_time_constant (1800 s).
Verified by validation/beta_blocker_dose_response.feature (Simulink Test, draft-mode passing 2026-06-19).
Trace target: top-level pipeline BetaBlockerDose -> BetaBlockerPK -> HeartRateModel.
Rationale: Demonstrates the digital twin produces a clinically directionally-correct chronotropic response to dose escalation, enabling its use as a decision-support tool for cardiologist titration review.
Keywords: draft, auto-generated, system, dose-response

### 1.1 [REQ_CDT_002] At steady state, the cardiac digital twin shall compute heart rate as baseline_heart_rate (75 bpm) - beta_hr_sensitivity (0.24 bpm/mg) * beta_blocker_dose_mg, within +/- 0.5 bpm tolerance, for any dose in the range [0 mg, 145 mg].
Performance requirement on the HeartRateModel subsystem under steady-state PK assumptions (plasma concentration equals dose, since the PK transfer function has unity DC gain).
The +/- 0.5 bpm tolerance allows for numerical solver settling within 5 * pk_time_constant (1800 s).
Dose upper limit of 145 mg is the largest dose for which the unsaturated formula stays within the physiological clamp range [40, 180] bpm: 75 - 0.24 * 145 = 40.2 bpm.
Rationale: Pins the model's chronotropic gain to a calibrated, clinically plausible response (~12 bpm reduction at 50 mg metoprolol succinate), and bounds the validity domain of the linear approximation.
Keywords: draft, auto-generated, performance, heart-rate

### 1.2 [REQ_CDT_003] If the prescribed dose lies within the therapeutic range [0 mg, 100 mg], then the cardiac digital twin shall maintain steady-state cardiac output at or above 4.0 L/min.
Safety floor on the CardiacOutputModel output. 4.0 L/min corresponds to a cardiac index of approximately 2.0 L/min/m^2 for a typical adult (BSA ~2.0 m^2), the conventional lower bound of adequate resting perfusion.
At the upper bound dose of 100 mg: HR = 75 - 0.24 * 100 = 51 bpm; CO = 51 * stroke_volume_mL (70) / 1000 = 3.57 L/min - which would FAIL this requirement, indicating that 100 mg cannot be considered safe under the current stroke_volume_mL assumption without compensatory inotropy.
Current 50 mg dose produces CO ~ 4.41 L/min (PASS). Current 60 mg dose produces CO ~ 4.25 L/min (PASS).
Verification: extend validation/beta_blocker_dose_response.feature with a CardiacOutputModel scenario asserting CO >= 4.0 at the dose boundary.
Rationale: Ensures the digital twin flags any dosing recommendation that would push the simulated patient below the clinical perfusion threshold, preventing the tool from endorsing a haemodynamically unsafe titration.
Keywords: draft, auto-generated, safety, cardiac-output